# Grasshopper definition am_wasp_direct_control.gh (Grasshopper 1.0.8)
# plug-ins: RhinoCodePluginGH

# ----
# --> Set your IP address
# --> Set WASP IP address
server_ip = ValueList({"192.168.10.44", "192.168.10.12", "192.168.10.11", "192.168.10.10", "192.168.10.2", "127.0.0.1", "192.168.10.111", "192.168.0.250", "192.168.0.30", "10.42.0.212", "10.42.0.133"}, selected="192.168.0.250")
server_port = ValueList({"50002", "50003", "50005", "50006", "50007", "50008", "50009", "50010", "50011", "50012", "50013", "50014", "50015", "50016"}, selected="50005")

# ----
# WASP Settings
mixer_ip = ValueList({"192.168.125.22", "192.168.125.23", "192.168.125.24"}, selected="192.168.125.24")
ext_ip = ValueList({"192.168.10.10", "192.168.10.20", "192.168.10.11", "192.168.10.12", "127.0.0.1", "192.168.10.111", "192.168.0.220", "192.168.0.30", "192.168.10.50", "0.0.0.0", "192.168.125.22"}, selected="192.168.125.22")
cfs_ip = ValueList({"192.168.125.22", "192.168.125.23", "192.168.125.24"}, selected="192.168.125.23")
mixer_port = ValueList({"50003", "50004"}, selected="50004")
ext_port = ValueList({"50003", "50004"}, selected="50004")
cfs_port = ValueList({"50003", "50004"}, selected="50004")
globals = IronPython2Script(
    server_ip=server_ip,
    server_port=server_port,
    ext_ip=ext_ip,
    ext_port=ext_port,
    cfs_ip=cfs_ip,
    cfs_port=cfs_port,
    mixer_ip=mixer_ip,
    mixer_port=mixer_port,
    clear=Button())  # inputs cfs_port: Int32
# ---------- globals: IronPython ----------
from scriptcontext import sticky as st

st["server_ip"] = server_ip
st["server_port"] = server_port

st["ext_ip"] = ext_ip
st["ext_port"] = ext_port

st["cfs_ip"] = cfs_ip
st["cfs_port"] = cfs_port

st["mixer_ip"] = mixer_ip
st["mixer_port"] = mixer_port
print(type(ext_port))
if clear:
    st.clear()

print(st["server_ip"])
# ---------- end globals ----------

speed = Slider(10000, range=0..51200)
max_speed = Slider(10000, range=0..51200)
send = Button()
value = BooleanToggle(False)

max_speed_2 = Slider(10000, range=0..51200)
speed_2 = Slider(20000, range=0..51200)
value_2 = BooleanToggle(False)
send_2 = Button()

speed_3 = Slider(15000, range=0..51200)
max_speed_3 = Slider(15000, range=0..51200)
send_3 = Button()
value_3 = BooleanToggle(False)

# ----
# Direct WASP control
# Set only CFS data
# Set Extruder and CFS data
# Set Mixer Data
value_4 = BooleanToggle(False)
send_4 = Button()
globals_2 = IronPython2Script(motor_state=value, max_speed=max_speed, speed=speed, send=send)  # inputs send: list
# ---------- globals_2: IronPython ----------
import time
from scriptcontext import sticky as st
from extruder_control_wasp.extruderclient import ExtruderClient

ext_ip = st["ext_ip"]
ext_port = st["ext_port"]
cfs_ip = st["cfs_ip"]
cfs_port = st["cfs_port"]

ec = ExtruderClient(ext_ip, ext_port)
cfs = ExtruderClient(cfs_ip, cfs_port)
cfs_speed1 = float(max_speed/2)
cfs_speed2 = float(speed/2)
wait_for_response = False

if send:
    cfs.connect()
    ec.connect()
    time.sleep(0.2)
    cfs.send_motordata(motor_state, cfs_speed1, cfs_speed2, wait_for_response)
    ec.send_motordata(motor_state, max_speed, speed, wait_for_response)
    time.sleep(0.2)
    ec.close()
    cfs.close()
# ---------- end globals_2 ----------
globals_3 = IronPython2Script(motor_state=value_4, send=send_4)  # inputs send: list
# ---------- globals_3: IronPython ----------
import time
from scriptcontext import sticky as st
from extruder_control_wasp.extruderclient import ExtruderClient

mixer_ip = st["mixer_ip"]
mixer_port = st["mixer_port"]

mixer = ExtruderClient(mixer_ip, mixer_port)
wait_for_response = False

if send:
    mixer.connect()
    time.sleep(0.2)
    mixer.send_motorstate(int(motor_state), wait_for_response)
    time.sleep(0.2)
    mixer.close()
# ---------- end globals_3 ----------
globals_4 = IronPython2Script(motor_state=value_2, max_speed=max_speed_2, speed=speed_2, send=send_2)  # inputs send: list
# ---------- globals_4: IronPython ----------
import time
from scriptcontext import sticky as st
from extruder_control_wasp.extruderclient import ExtruderClient

mixer_ip = st["mixer_ip"]
mixer_port = st["mixer_port"]

mixer = ExtruderClient(mixer_ip, mixer_port)

wait_for_response = False

if send:
    mixer.connect()
    time.sleep(0.2)
    mixer.send_motordata(motor_state, max_speed, speed, wait_for_response)
    time.sleep(0.2)
    mixer.close()
# ---------- end globals_4 ----------
globals_5 = IronPython2Script(motor_state=value_3, max_speed=max_speed_3, speed=speed_3, send=send_3)  # inputs send: list
# ---------- globals_5: IronPython ----------
import time
from scriptcontext import sticky as st
from extruder_control_wasp.extruderclient import ExtruderClient

cfs_ip = st["cfs_ip"]
cfs_port = st["cfs_port"]

cfs = ExtruderClient(cfs_ip, cfs_port)
cfs_speed1 = float(max_speed/2)
cfs_speed2 = float(speed/2)
wait_for_response = False

if send:
    cfs.connect()
    time.sleep(0.2)
    cfs.send_motordata(motor_state, cfs_speed1, cfs_speed2, wait_for_response)
    time.sleep(0.2)
    cfs.close()
# ---------- end globals_5 ----------
